# Dynamo graph CustomSelectionSchedule.dyn (Dynamo 1.0.1.1036)

select_model_elements = DSModelElementsSelection()  # 266 picked in the model
name = FamilyType.Name(select_model_elements)
file_path = Filename("\\hre-dc\839-Shares\Private\nmoore\Documents\HRE-ProjectInfo\test")
string = StringInput("Data")
code_block = CodeBlock { 0; }
string_2 = StringInput("ElementID")
string_3 = StringInput("Type")
string_4 = StringInput("Family")
string_5 = StringInput("Size")
string_6 = StringInput("Angle")
string_7 = StringInput("Length")
string_8 = StringInput("System Name")
string_9 = StringInput("System Abbreviation")
string_10 = StringInput("Mark")
headerList = List.Create(string_2, string_3, string_4, string_5, string_6, string_7, string_8, string_9, string_10)
code_block_2 = CodeBlock { 9; }
chop = List.Chop(list=headerList, lengths=code_block_2)
id = Element.Id(select_model_elements)
name_2 = Family.Name(select_model_elements)
getParameterValueByName = Element.GetParameterValueByName(element=select_model_elements, parameterName=string_4)
getParameterValueByName_2 = Element.GetParameterValueByName(element=select_model_elements, parameterName=string_5)
getParameterValueByName_3 = Element.GetParameterValueByName(element=select_model_elements, parameterName=string_6)
getParameterValueByName_4 = Element.GetParameterValueByName(element=select_model_elements, parameterName=string_7)
getParameterValueByName_5 = Element.GetParameterValueByName(element=select_model_elements, parameterName=string_8)
getParameterValueByName_6 = Element.GetParameterValueByName(element=select_model_elements, parameterName=string_9)
getParameterValueByName_7 = Element.GetParameterValueByName(element=select_model_elements, parameterName=string_10)
dataList = List.Create(id, name_2, getParameterValueByName, getParameterValueByName_2, getParameterValueByName_3, getParameterValueByName_4, getParameterValueByName_5, getParameterValueByName_6, getParameterValueByName_7)
transpose = List.Transpose(dataList)
comb_header_data = List.Create(chop, transpose)
code_block_3 = CodeBlock { 1; }
flatten = List.Flatten(list=comb_header_data, amt=code_block_3)
writeToFile = Excel.WriteToFile(filePath=file_path, sheetName=string, startRow=code_block, startCol=code_block, data=flatten)
parameters = Element.Parameters(select_model_elements)
string_11 = StringInput("Pipe Segment")
lunchbox_get_parameter_value = Custom[LunchBox Get Parameter Value](ParamName=string_11)  # Gets parameter values from a Revit element.
code_block_4 = CodeBlock { 1; }
flatten_2 = List.Flatten(list=lunchbox_get_parameter_value, amt=code_block_4)
