# Dynamo graph FittingSchedule.dyn (Dynamo 1.2.2.373)

file_path = Filename("..\..\Takeoffs\MD\Underground\fittings_MD.xlsx")
code_block = CodeBlock { "Sheet1"; }
code_block_2 = CodeBlock { 0; }
code_block_3 = CodeBlock { "System Classification"; }
code_block_4 = CodeBlock { "Family and Type"; }
code_block_5 = CodeBlock { "Angle"; }
code_block_6 = CodeBlock { "Size"; }
code_block_7 = CodeBlock { "Size 2"; }
code_block_8 = CodeBlock { "Size 3"; }
code_block_9 = CodeBlock { "Count"; }
create = List.Create(code_block_3, code_block_4, code_block_5, code_block_6, code_block_7, code_block_8, code_block_9)
categories = Categories("PipeFitting")
all_elements_of_category = ElementsOfCategory(categories)
code_block_10 = CodeBlock { "Comments"; }
getParameterValueByName = Element.GetParameterValueByName(element=all_elements_of_category, parameterName=code_block_10)
code_block_11 = CodeBlock(x=getParameterValueByName)
# ---------- code_block_11.designscript (3 lines) ----------
x == "Underground" ?
true:
false;
# ----------------------------------------
filterByBoolMask = List.FilterByBoolMask(list=all_elements_of_category, mask=code_block_11)
getParameterValueByName_2 = Element.GetParameterValueByName(element=filterByBoolMask.in, parameterName=code_block_3)
getParameterValueByName_3 = Element.GetParameterValueByName(element=filterByBoolMask.in, parameterName=code_block_4)
getParameterValueByName_4 = Element.GetParameterValueByName(element=filterByBoolMask.in, parameterName=code_block_5)
getParameterValueByName_5 = Element.GetParameterValueByName(element=filterByBoolMask.in, parameterName=code_block_6)
count = Count(filterByBoolMask.in)
cycle = List.Cycle(list=code_block_7, amount=count)
cycle_2 = List.Cycle(list=code_block_8, amount=count)
code_block_12 = CodeBlock { 1; }
cycle_3 = List.Cycle(list=code_block_12, amount=count)
create_2 = List.Create(getParameterValueByName_2, getParameterValueByName_3, getParameterValueByName_4, getParameterValueByName_5, cycle, cycle_2, cycle_3)
transpose = List.Transpose(create_2)
addItemToFront = List.AddItemToFront(item=create, list=transpose)
boolean = BoolSelector(true)
writeToFile = Excel.WriteToFile(filePath=file_path, sheetName=code_block, startRow=code_block_2, startCol=code_block_2, data=addItemToFront, overWrite=boolean)
