# Dynamo graph FittingSchedule2.dyn (Dynamo 2.0.2.6826)

file_path = Filename("..\..\Takeoffs\MD\Underground\fittings_MD.xlsx")  # graph input
code_block = CodeBlock { "Sheet1"; }
code_block_2 = CodeBlock { 0; }
code_block_3 = CodeBlock { "System Classification"; }
code_block_4 = CodeBlock { "Family and Type"; }
code_block_5 = CodeBlock { "Angle"; }
code_block_6 = CodeBlock { "Size"; }
code_block_7 = CodeBlock { "Size 2"; }
code_block_8 = CodeBlock { "Size 3"; }
code_block_9 = CodeBlock { "Count"; }
create = List.Create(item0=code_block_3, item1=code_block_4, item2=code_block_5, item3=code_block_6, item4=code_block_7, item5=code_block_8, item6=code_block_9)
categories = Categories(index=337)  # graph input
all_elements_of_category = ElementsOfCategory(Category=categories)
code_block_10 = CodeBlock { "Comments"; }
getParameterValueByName = Element.GetParameterValueByName(element=all_elements_of_category, parameterName=code_block_10)
code_block_11 = CodeBlock(x=getParameterValueByName)
# ---------- code_block_11.designscript (3 lines) ----------
x == "Underground" ?
true:
false;
# ----------------------------------------
filterByBoolMask = List.FilterByBoolMask(list=all_elements_of_category, mask=code_block_11)
getParameterValueByName_2 = Element.GetParameterValueByName(element=filterByBoolMask.in, parameterName=code_block_3)
getParameterValueByName_3 = Element.GetParameterValueByName(element=filterByBoolMask.in, parameterName=code_block_4)
getParameterValueByName_4 = Element.GetParameterValueByName(element=filterByBoolMask.in, parameterName=code_block_5)
getParameterValueByName_5 = Element.GetParameterValueByName(element=filterByBoolMask.in, parameterName=code_block_6)
count = List.Count(list=filterByBoolMask.in)
cycle = List.Cycle(list=code_block_7, amount=count)
cycle_2 = List.Cycle(list=code_block_8, amount=count)
code_block_12 = CodeBlock { 1; }
cycle_3 = List.Cycle(list=code_block_12, amount=count)
create_2 = List.Create(item0=getParameterValueByName_2, item1=getParameterValueByName_3, item2=getParameterValueByName_4, item3=getParameterValueByName_5, item4=cycle, item5=cycle_2, item6=cycle_3)
transpose = List.Transpose(lists=create_2)
addItemToFront = List.AddItemToFront(item=create, list=transpose)
boolean = BoolSelector(true)  # graph input
exportExcel = Data.ExportExcel(filePath=file_path, sheetName=code_block, startRow=code_block_2, startCol=code_block_2, data=addItemToFront, overWrite=boolean)
