# Dynamo graph MultipleSchedules2ONExlsx.dyn (Dynamo 1.2.1.3083)

# group: Collect All views and Names
element_types = ElementTypes("ViewSchedule")
all_elements_of_type = ElementsOfType(element_types)
name = Element.Name(all_elements_of_type)

# group: List Name filter
string = StringInput("Fabrication")
boolean = BoolSelector(true)
contains = String.Contains(str=name, searchFor=string, ignoreCase=boolean)

# group: Specific List Collector
filterByBoolMask = List.FilterByBoolMask(list=all_elements_of_type, mask=contains)
name_2 = Element.Name(filterByBoolMask.in)

# group: Export Schedule to CSV
directory_path = Directory("E:\Users\Nathan Moore\Desktop\test")
code_block = CodeBlock(filename=name_2) { filename + ".csv"; }
schedule_export = Python(IN[0]=filterByBoolMask.in, IN[1]=directory_path, IN[2]=code_block)
# ---------- schedule_export.python (21 lines) ----------
import clr
clr.AddReference('RevitAPI')
from Autodesk.Revit.DB import *
#The inputs to this node will be stored as a list in the IN variables.
schedule_list = IN[0]
path = IN[1]
filename_list = IN[2]
result_list = []

#Process schedules
for index, sched in enumerate(schedule_list):
	schedule = UnwrapElement(sched)
	filename = filename_list[index]
	try:
		export_options = ViewScheduleExportOptions()
		schedule.Export(path, filename, export_options)
		result_list.append("Schedule exported")
	except: result_list.append("Export fail")

#Assign your output to the OUT variable.
OUT = result_list
# ----------------------------------------

# group: Create File Path for CSV
string_from_object = FromObject(directory_path)
string_2 = StringInput("\")
concat = String.Concat(string_from_object, string_2)
string_from_object_2 = FromObject(code_block)
count = Count(string_from_object_2)
cycle = List.Cycle(list=concat, amount=count)
create = List.Create(cycle, string_from_object_2)
transpose = List.Transpose(create)
concat_2 = String.Concat(transpose)

# group: Read CSV
fromPath = FileObject(concat_2)  # "File.FromPath"
readFromFile = CSV.ReadFromFile(fromPath)

# group: Format CSV to List
number = DoubleInput(1)
flatten = List.Flatten(list=readFromFile, amt=number)
string_3 = StringInput(" ")
split = String.Split(flatten, string_3)
code_block_2 = CodeBlock(lst=split) { Flatten(lst<1><2>); }
string_4 = StringInput("\"")
string_5 = StringInput("")
replace = String.Replace(str=code_block_2, searchFor=string_4, replaceWith=string_5)

# group: BB data
create_2 = List.Create(name_2)
flatten_2 = Flatten(create_2)
string_6 = StringInput("A1")
count_2 = Count(filterByBoolMask.in)
cycle_2 = List.Cycle(list=string_6, amount=count_2)

# group: Shorten Title
string_7 = StringInput(")")
split_2 = String.Split(flatten_2, string_7)
transpose_2 = List.Transpose(split_2)
deconstruct = List.Deconstruct(list=transpose_2)
trimTrailingWhitespace = String.TrimTrailingWhitespace(deconstruct.rest)
trimLeadingWhitespace = String.TrimLeadingWhitespace(trimTrailingWhitespace)
flatten_3 = Flatten(trimLeadingWhitespace)
string_8 = StringInput("-")
split_3 = String.Split(flatten_3, string_8)
transpose_3 = List.Transpose(split_3)
deconstruct_2 = List.Deconstruct(list=transpose_3)
trimTrailingWhitespace_2 = String.TrimTrailingWhitespace(deconstruct_2.first)
trimLeadingWhitespace_2 = String.TrimLeadingWhitespace(trimTrailingWhitespace_2)
trimTrailingWhitespace_3 = String.TrimTrailingWhitespace(deconstruct_2.rest)
trimLeadingWhitespace_3 = String.TrimLeadingWhitespace(trimTrailingWhitespace_3)
code_block_3 = CodeBlock(x=trimLeadingWhitespace_3)
# ---------- code_block_3.designscript (7 lines) ----------
x == "Pipe" ?
"-P":
x == "Fittings" ?
"-F":
x == "Accessories" ?
"-A":
"Whoops";
# ----------------------------------------
flatten_4 = Flatten(code_block_3)
create_3 = List.Create(trimLeadingWhitespace_2, flatten_4)
transpose_4 = List.Transpose(create_3)
concat_3 = String.Concat(transpose_4)
length = String.Length(concat_3)
maximumItem = List.MaximumItem(length)

# group (continued): BB data
bb_data = Custom[BB Data](SheetName=concat_3, Origin=cycle_2, Data=replace)  # This node is a building block for different modes of writing to Excel files. You can combines this node into a list to write to multiple sheets or use just one to write to a single sheet.

# group: Write to Excel
file_path = Filename("E:\bb")
boolean_2 = BoolSelector(true)
boolean_3 = BoolSelector(false)
write_excel = Custom[Write Excel](filePath=file_path, RunIt=boolean_2, ByColumn=boolean_3, BBData=bb_data)  # This node will write data to Excel file and based on how your BBData nodes are structured it will either override the exsting file, create a new one and write a single worksheet or write multiple worksheets.
