# Dynamo graph MultipleSchedulesEXPORT.dyn (Dynamo 1.2.1.3083)

# group: Collect All views and Names
element_types = ElementTypes("ViewSchedule")
all_elements_of_type = ElementsOfType(element_types)
name = Element.Name(all_elements_of_type)

# group: List Name filter
string = StringInput("Fabrication")
boolean = BoolSelector(true)
contains = String.Contains(str=name, searchFor=string, ignoreCase=boolean)

# group: Specific List Collector
filterByBoolMask = List.FilterByBoolMask(list=all_elements_of_type, mask=contains)
name_2 = Element.Name(filterByBoolMask.in)

string_2 = StringInput("CCAP-")
string_3 = StringInput("/")
string_4 = StringInput("_")
replace = String.Replace(str=name_2, searchFor=string_3, replaceWith=string_4)
dropFirstWord = Custom[String.DropFirstWord](String=replace)  # Removes the set of characters upto the first whitespace in the string
trimTrailingWhitespace = String.TrimTrailingWhitespace(dropFirstWord)
trimLeadingWhitespace = String.TrimLeadingWhitespace(trimTrailingWhitespace)
flatten = Flatten(trimLeadingWhitespace)
string_5 = StringInput("-")
split = String.Split(flatten, string_5)
transpose = List.Transpose(split)
deconstruct = List.Deconstruct(list=transpose)
trimTrailingWhitespace_2 = String.TrimTrailingWhitespace(deconstruct.first)
trimLeadingWhitespace_2 = String.TrimLeadingWhitespace(trimTrailingWhitespace_2)
trimTrailingWhitespace_3 = String.TrimTrailingWhitespace(deconstruct.rest)
trimLeadingWhitespace_3 = String.TrimLeadingWhitespace(trimTrailingWhitespace_3)
code_block = CodeBlock(x=trimLeadingWhitespace_3)
# ---------- code_block.designscript (7 lines) ----------
x == "Pipe" ?
"-P":
x == "Fittings" ?
"-F":
x == "Accessories" ?
"-A":
"Whoops";
# ----------------------------------------
flatten_2 = Flatten(code_block)
create = List.Create(trimLeadingWhitespace_2, flatten_2)
transpose_2 = List.Transpose(create)
concat = String.Concat(transpose_2)
dropFirstWord_2 = Custom[String.DropFirstWord](String=concat)
flatten_3 = Flatten(dropFirstWord_2)
count = Count(flatten_3)
cycle = List.Cycle(list=string_2, amount=count)
create_2 = List.Create(cycle, dropFirstWord)
transpose_3 = List.Transpose(create_2)
concat_2 = String.Concat(transpose_3)
flatten_4 = Flatten(concat_2)
flatten_5 = Flatten(flatten_4)

# group: Export Schedule to CSV
directory_path = Directory("E:\Users\Nathan Moore\Desktop\SPX")
code_block_2 = CodeBlock(filename=flatten_5) { filename + ".csv"; }
schedule_export = Python(IN[0]=filterByBoolMask.in, IN[1]=directory_path, IN[2]=code_block_2)
# ---------- schedule_export.python (21 lines) ----------
import clr
clr.AddReference('RevitAPI')
from Autodesk.Revit.DB import *
#The inputs to this node will be stored as a list in the IN variables.
schedule_list = IN[0]
path = IN[1]
filename_list = IN[2]
result_list = []

#Process schedules
for index, sched in enumerate(schedule_list):
	schedule = UnwrapElement(sched)
	filename = filename_list[index]
	try:
		export_options = ViewScheduleExportOptions()
		schedule.Export(path, filename, export_options)
		result_list.append("Schedule exported")
	except: result_list.append("Export fail")

#Assign your output to the OUT variable.
OUT = result_list
# ----------------------------------------

string_6 = StringInput("-")
split_2 = String.Split(arg1=string_6)  # unwired: arg0
transpose_4 = List.Transpose(split_2)
deconstruct_2 = List.Deconstruct(list=transpose_4)
length = String.Length(concat)
maximumItem = List.MaximumItem(length)
length_2 = String.Length(flatten_4)
maximumItem_2 = List.MaximumItem(length_2)
