# Dynamo graph PipeScheduleSimple.dyn (Dynamo 1.2.1.3083)

file_path = Filename("..\..\test.xlsx")
string = StringInput("NOB")
number = DoubleInput(0)
string_2 = StringInput("Type")
string_3 = StringInput("Diameter")
string_4 = StringInput("Length")
string_5 = StringInput("System Type")
create = List.Create(string_2, string_3, string_4, string_5)
select_model_elements = DSModelElementsSelection()  # 90 picked in the model
categories = Categories("PipeCurves")
isOfCategory = Custom[Element.IsOfCategory](element=select_model_elements, category=categories)  # Checks whether an element is of a specified category
filterByBoolMask = List.FilterByBoolMask(list=select_model_elements, mask=isOfCategory)
lunchbox_get_parameter_value = Custom[LunchBox Get Parameter Value](Element=filterByBoolMask.in, ParamName=string_2)  # Gets parameter values from a Revit element.
lunchbox_get_parameter_value_2 = Custom[LunchBox Get Parameter Value](Element=filterByBoolMask.in, ParamName=string_3)
lunchbox_get_parameter_value_3 = Custom[LunchBox Get Parameter Value](Element=filterByBoolMask.in, ParamName=string_4)
lunchbox_get_parameter_value_4 = Custom[LunchBox Get Parameter Value](Element=filterByBoolMask.in, ParamName=string_5)
create_2 = List.Create(lunchbox_get_parameter_value, lunchbox_get_parameter_value_2, lunchbox_get_parameter_value_3, lunchbox_get_parameter_value_4)
number_2 = DoubleInput(1)
flatten = List.Flatten(list=create_2, amt=number_2)
transpose = List.Transpose(flatten)
addItemToFront = List.AddItemToFront(item=create, list=transpose)
writeToFile = Excel.WriteToFile(filePath=file_path, sheetName=string, startRow=number, startCol=number, data=addItemToFront)
