# Dynamo graph PipefFittingSchedulenoworkset.dyn (Dynamo 1.2.1.3083)

select_model_elements = DSModelElementsSelection()  # 101 picked in the model
categories = Categories("DuctFitting")
isOfCategory = Custom[Element.IsOfCategory](element=select_model_elements, category=categories)  # Checks whether an element is of a specified category
filterByBoolMask = List.FilterByBoolMask(list=select_model_elements, mask=isOfCategory)
name = FamilyType.Name(filterByBoolMask.in)
file_path = Filename("E:\test3")
string = StringInput("NOB-D")
code_block = CodeBlock { 0; }
code_block_2 = CodeBlock { 0; }
string_2 = StringInput("Family")
string_3 = StringInput("ElementID")
string_4 = StringInput("Mark")
string_5 = StringInput("Angle")
string_6 = StringInput("Size")
string_7 = StringInput("CAA Status")
string_8 = StringInput("concat")
string_9 = StringInput("System Type")
headerList = List.Create(string_2, string_3, string_4, string_5, string_6, string_7, string_8, string_9)
create = List.Create(headerList)
flatten = Flatten(create)
lunchbox_get_parameter_value = Custom[LunchBox Get Parameter Value](Element=filterByBoolMask.in, ParamName=string_2)  # Gets parameter values from a Revit element.
code_block_3 = CodeBlock { 1; }
flatten_2 = List.Flatten(list=lunchbox_get_parameter_value, amt=code_block_3)
id = Element.Id(filterByBoolMask.in)
getParameterValueByName = Element.GetParameterValueByName(element=filterByBoolMask.in, parameterName=string_4)
getParameterValueByName_2 = Element.GetParameterValueByName(element=filterByBoolMask.in, parameterName=string_5)
code_block_4 = CodeBlock(x=getParameterValueByName_2)
# ---------- code_block_4.designscript (9 lines) ----------
x>65 && x<100?
90:
x>32 && x<65?
45:
x>16 && x<32?
22.5:
x<16?
11.25:
null;
# ----------------------------------------
getParameterValueByName_3 = Element.GetParameterValueByName(element=filterByBoolMask.in, parameterName=string_6)
getParameterValueByName_4 = Element.GetParameterValueByName(element=filterByBoolMask.in, parameterName=string_7)
string_from_object = FromObject(code_block_4)
code_block_5 = CodeBlock(x=string_from_object, y=flatten_2)
# ---------- code_block_5.designscript (3 lines) ----------
x=="null"?
y:
x+"-"+y;
# ----------------------------------------
lunchbox_get_parameter_value_2 = Custom[LunchBox Get Parameter Value](Element=filterByBoolMask.in, ParamName=string_9)
flatten_3 = Flatten(lunchbox_get_parameter_value_2)
dataList = List.Create(flatten_2, id, getParameterValueByName, code_block_4, getParameterValueByName_3, getParameterValueByName_4, code_block_5, flatten_3)
transpose = List.Transpose(dataList)
addItemToFront = List.AddItemToFront(item=flatten, list=transpose)
writeToFile = Excel.WriteToFile(filePath=file_path, sheetName=string, startRow=code_block, startCol=code_block_2, data=addItemToFront)
parameters = Element.Parameters(filterByBoolMask.in)
