# Dynamo graph TotalVolumePiping.dyn (Dynamo 1.2.1.3083)

categories = Categories("PipeCurves")
all_elements_of_category = ElementsOfCategory(categories)
string = StringInput("System Abbreviation")
getParameterValueByName = Element.GetParameterValueByName(element=all_elements_of_category, parameterName=string)
uniqueItems = List.UniqueItems(getParameterValueByName)
code_block = CodeBlock(x=getParameterValueByName)
# ---------- code_block.designscript (3 lines) ----------
x == "CHS" || x == "CHR" ?
true:
false;
# ----------------------------------------
uniqueItems_2 = List.UniqueItems(code_block)
string_2 = StringInput("System Abbreviation")
getParameterValueByName_2 = Element.GetParameterValueByName(element=all_elements_of_category, parameterName=string_2)
uniqueItems_3 = List.UniqueItems(getParameterValueByName_2)
code_block_2 = CodeBlock(x=getParameterValueByName_2)
# ---------- code_block_2.designscript (3 lines) ----------
x == "HWS" || x == "HWR" ?
true:
false;
# ----------------------------------------
uniqueItems_4 = List.UniqueItems(code_block_2)
file_path = Filename("E:\liters")
string_3 = StringInput("CMPD")
number = DoubleInput(0)
string_4 = StringInput("-")
string_5 = StringInput("Chilled Water Supply/Return Liters")
concat = String.Concat(string_3, string_4, string_5)
filterByBoolMask = List.FilterByBoolMask(list=all_elements_of_category, mask=code_block)
string_6 = StringInput("Size")
getParameterValueByName_3 = Element.GetParameterValueByName(element=filterByBoolMask.in, parameterName=string_6)
string_7 = StringInput("ø")
removeAfterGivenCharacter = Custom[String.RemoveAfterGivenCharacter](str=getParameterValueByName_3, Character=string_7)  # This will move all characters at and after the given character.
toNumber = String.ToNumber(removeAfterGivenCharacter)
PI = Math.PI()
string_8 = StringInput("Length")
getParameterValueByName_4 = Element.GetParameterValueByName(element=filterByBoolMask.in, parameterName=string_8)
formula = Formula("(((x/2)*(x/2))*y)*z", x=toNumber, y=PI, z=getParameterValueByName_4)
code_block_3 = CodeBlock(x=formula) { x/1000000; }
sum = Math.Sum(code_block_3)
create = List.Create(concat, sum)
string_9 = StringInput("-")
string_10 = StringInput("Heating Water Supply/Return Liters")
concat_2 = String.Concat(string_3, string_9, string_10)
filterByBoolMask_2 = List.FilterByBoolMask(list=all_elements_of_category, mask=code_block_2)
string_11 = StringInput("Size")
getParameterValueByName_5 = Element.GetParameterValueByName(element=filterByBoolMask_2.in, parameterName=string_11)
string_12 = StringInput("ø")
removeAfterGivenCharacter_2 = Custom[String.RemoveAfterGivenCharacter](str=getParameterValueByName_5, Character=string_12)
toNumber_2 = String.ToNumber(removeAfterGivenCharacter_2)
PI_2 = Math.PI()
string_13 = StringInput("Length")
getParameterValueByName_6 = Element.GetParameterValueByName(element=filterByBoolMask_2.in, parameterName=string_13)
formula_2 = Formula("(((x/2)*(x/2))*y)*z", x=toNumber_2, y=PI_2, z=getParameterValueByName_6)
code_block_4 = CodeBlock(x=formula_2) { x/1000000; }
sum_2 = Math.Sum(code_block_4)
create_2 = List.Create(concat_2, sum_2)
string_14 = StringInput("-")
string_15 = StringInput("Condenser Water Supply/Return Liters")
concat_3 = String.Concat(string_3, string_14, string_15)
string_16 = StringInput("System Abbreviation")
getParameterValueByName_7 = Element.GetParameterValueByName(element=all_elements_of_category, parameterName=string_16)
code_block_5 = CodeBlock(x=getParameterValueByName_7)
# ---------- code_block_5.designscript (3 lines) ----------
x == "CWS" || x == "CWR" ?
true:
false;
# ----------------------------------------
filterByBoolMask_3 = List.FilterByBoolMask(list=all_elements_of_category, mask=code_block_5)
string_17 = StringInput("Size")
getParameterValueByName_8 = Element.GetParameterValueByName(element=filterByBoolMask_3.in, parameterName=string_17)
string_18 = StringInput("ø")
removeAfterGivenCharacter_3 = Custom[String.RemoveAfterGivenCharacter](str=getParameterValueByName_8, Character=string_18)
toNumber_3 = String.ToNumber(removeAfterGivenCharacter_3)
PI_3 = Math.PI()
string_19 = StringInput("Length")
getParameterValueByName_9 = Element.GetParameterValueByName(element=filterByBoolMask_3.in, parameterName=string_19)
formula_3 = Formula("(((x/2)*(x/2))*y)*z", x=toNumber_3, y=PI_3, z=getParameterValueByName_9)
code_block_6 = CodeBlock(x=formula_3) { x/1000000; }
sum_3 = Math.Sum(code_block_6)
create_3 = List.Create(concat_3, sum_3)
string_20 = StringInput("-")
string_21 = StringInput("Chilled Water Supply/Return Liters")
concat_4 = String.Concat(string_3, string_20, string_21)
string_22 = StringInput("System Abbreviation")
getParameterValueByName_10 = Element.GetParameterValueByName(element=all_elements_of_category, parameterName=string_22)
code_block_7 = CodeBlock(x=getParameterValueByName_10)
# ---------- code_block_7.designscript (3 lines) ----------
x == "CHWS" || x == "CHWR" ?
true:
false;
# ----------------------------------------
filterByBoolMask_4 = List.FilterByBoolMask(list=all_elements_of_category, mask=code_block_7)
string_23 = StringInput("Size")
getParameterValueByName_11 = Element.GetParameterValueByName(element=filterByBoolMask_4.in, parameterName=string_23)
toNumber_4 = String.ToNumber(getParameterValueByName_11)
PI_4 = Math.PI()
string_24 = StringInput("Length")
getParameterValueByName_12 = Element.GetParameterValueByName(element=filterByBoolMask_4.in, parameterName=string_24)
formula_4 = Formula("(((x/2)*(x/2))*y)*z", x=toNumber_4, y=PI_4, z=getParameterValueByName_12)
code_block_8 = CodeBlock(x=formula_4) { x/1000000; }
sum_4 = Math.Sum(code_block_8)
create_4 = List.Create(concat_4, sum_4)
string_25 = StringInput("-")
string_26 = StringInput("Heating Water Supply/Return Liters")
concat_5 = String.Concat(string_3, string_25, string_26)
string_27 = StringInput("System Abbreviation")
getParameterValueByName_13 = Element.GetParameterValueByName(element=all_elements_of_category, parameterName=string_27)
code_block_9 = CodeBlock(x=getParameterValueByName_13)
# ---------- code_block_9.designscript (3 lines) ----------
x == "HHWS" || x == "HHWR" ?
true:
false;
# ----------------------------------------
filterByBoolMask_5 = List.FilterByBoolMask(list=all_elements_of_category, mask=code_block_9)
string_28 = StringInput("Size")
getParameterValueByName_14 = Element.GetParameterValueByName(element=filterByBoolMask_5.in, parameterName=string_28)
toNumber_5 = String.ToNumber(getParameterValueByName_14)
PI_5 = Math.PI()
string_29 = StringInput("Length")
getParameterValueByName_15 = Element.GetParameterValueByName(element=filterByBoolMask_5.in, parameterName=string_29)
formula_5 = Formula("(((x/2)*(x/2))*y)*z", x=toNumber_5, y=PI_5, z=getParameterValueByName_15)
code_block_10 = CodeBlock(x=formula_5) { x/1000000; }
sum_5 = Math.Sum(code_block_10)
create_5 = List.Create(concat_5, sum_5)
create_6 = List.Create(create, create_2, create_3, create_4, create_5)  # frozen
writeToFile = Excel.WriteToFile(filePath=file_path, sheetName=string_3, startRow=number, startCol=number, data=create_6)
string_30 = StringInput(" ")
string_31 = StringInput(" ")
uniqueItems_5 = List.UniqueItems(code_block_5)
string_32 = StringInput(" ")
uniqueItems_6 = List.UniqueItems(getParameterValueByName_7)
uniqueItems_7 = List.UniqueItems(getParameterValueByName_10)
uniqueItems_8 = List.UniqueItems(code_block_7)
string_33 = StringInput(" ")
string_34 = StringInput("ø")
removeAfterGivenCharacter_4 = Custom[String.RemoveAfterGivenCharacter](str=getParameterValueByName_11, Character=string_34)
string_35 = StringInput("ø")
removeAfterGivenCharacter_5 = Custom[String.RemoveAfterGivenCharacter](str=getParameterValueByName_14, Character=string_35)
uniqueItems_9 = List.UniqueItems(code_block_9)
string_36 = StringInput(" ")
uniqueItems_10 = List.UniqueItems(getParameterValueByName_13)
