# Dynamo graph exportDampersch.dyn (Dynamo 1.2.2.373)

code_block = CodeBlock { "Test.xls"; }
all_elements_of_type = ElementsOfType()  # unwired: arg0
get_all_views = Custom[Get All Views]()  # This node will query all views in the model and return them based on category
watch = Watch(get_all_views.Schedules)
name = Element.Name(watch)
python_script = Python(IN[0]=name)
# ---------- python_script.python (21 lines) ----------
import clr
clr.AddReference('ProtoGeometry')
from Autodesk.DesignScript.Geometry import *
#The inputs to this node will be stored as a list in the IN variables.
data = IN[0]
lst = []
lst1 = ["exhaust", "supply", "transfer", "return", "relief", "grease",
    "outdoor", "outside", "outside air"]

for i in range(len(data)):
    t = True
    for x in lst1:
        if x in data[i].lower():
            t = False
            break
    if t and "damper schedule" in data[i].lower():
        lst.append(i)


#Assign your output to the OUT variable.
OUT = lst
# ----------------------------------------
getItemAtIndex = List.GetItemAtIndex(list=get_all_views.Schedules, index=python_script)
directory_path = Directory("E:\Dampers")
name_2 = Element.Name(getItemAtIndex)
code_block_2 = CodeBlock { "WHE"; }
code_block_3 = CodeBlock(filename=name_2, bldg=code_block_2) { filename + bldg + ".csv"; }
export_schedule_s = Python(IN[0]=getItemAtIndex, IN[1]=directory_path, IN[2]=code_block_3)
# ---------- export_schedule_s.python (20 lines) ----------
import clr
clr.AddReference('RevitAPI')
from Autodesk.Revit.DB import *

schedule_list = IN[0]
path = IN[1]
filename_list = IN[2]
result_list = []

for index, sched, in enumerate(schedule_list):
		schedule = UnwrapElement(sched)
		filename = filename_list[index]
	
		try:
			export_options = ViewScheduleExportOptions()
			schedule.Export(path, filename, export_options)
			result_list.append("Schedule Exported ")
		except: result_list.append("Export Failure ")
		
OUT = result_list
# ----------------------------------------
