# Dynamo graph pipeTakeoff.dyn (Dynamo 1.2.2.373)

file_path = Filename("E:\MCAP")
string = StringInput("MCAP")
number = DoubleInput(0)
string_2 = StringInput("Type")
string_3 = StringInput("ID")
string_4 = StringInput("NAME")
string_5 = StringInput("Size")
string_6 = StringInput("Length")
string_7 = StringInput("Angle")
create = List.Create(string_2, string_3, string_4, string_5, string_6, string_7)
select_model_elements = DSModelElementsSelection()  # 76 picked in the model
type = Custom[Element.Type](element=select_model_elements)  # This retrieves the element type of the given elements. (if available) Similar to others available but no python here.
id = Element.Id(select_model_elements)
element_name_universal = Custom[Element.Name (Universal)](element=select_model_elements)  # Gets an element's name (Dynamo's built-in Name nodes don't work for all element types, e.g. worksets...)
getParameterValueByName = Element.GetParameterValueByName(element=select_model_elements, parameterName=string_5)
getParameterValueByName_2 = Element.GetParameterValueByName(element=select_model_elements, parameterName=string_6)
getParameterValueByName_3 = Element.GetParameterValueByName(element=select_model_elements, parameterName=string_7)
create_2 = List.Create(type, id, element_name_universal, getParameterValueByName, getParameterValueByName_2, getParameterValueByName_3)
transpose = List.Transpose(create_2)
addItemToFront = List.AddItemToFront(item=create, list=transpose)
writeToFile = Excel.WriteToFile(filePath=file_path, sheetName=string, startRow=number, startCol=number, data=addItemToFront)
